# Dynamo graph OXOX.dyn "OXOX4.DYN" (Dynamo 2.6.1.8786)

# group: NOTES
# note: Does not output O wins

# group: Get the O and X families
code_block = CodeBlock { ["X", "O"]; }
byName = FamilyType.ByName(name=code_block)
# note: X = list 0
# O = list 1
byFamilyType = FamilyInstance.ByFamilyType(familyType=byName)

code_block_2 = CodeBlock(FamType=byName) { FamType; }

# group: Make my board
code_block_3 = CodeBlock { 1500; }
byWidthLength = Rectangle.ByWidthLength(width=code_block_3, length=code_block_3)
code_block_4 = CodeBlock()
# ---------- code_block_4.designscript (3 lines) ----------
//squares 0, 1, 2;
[-1500, 0, 1500];
[-1500, 0, 1500];
# ----------------------------------------
translate = Geometry.Translate(geometry=byWidthLength, xTranslation=code_block_4.out0, yTranslation=code_block_4.out1, lacing=CrossProduct)

transpose = List.Transpose(lists=translate)

# group (continued): Make my board
# note: Game squares
flatten = List.Flatten(list=transpose)

code_block_5 = CodeBlock(GameSquares=flatten) { GameSquares; }
code_block_6 = CodeBlock(GameSquares=code_block_5) { GameSquares; }

# group: Tests for first move
code_block_7 = CodeBlock(i=byFamilyType) { i[0]; }
isEmpty = List.IsEmpty(list=code_block_7)

# group: User Input
square_choose_1 = Python(IN[0]=isEmpty)
# ---------- square_choose_1.python (38 lines) ----------
import clr
clr.AddReference('ProtoGeometry')
from Autodesk.DesignScript.Geometry import *

clr.AddReference('RevitAPI')
import Autodesk
from Autodesk.Revit.DB import *

clr.AddReference('RevitNodes')
import Revit
clr.ImportExtensions(Revit.GeometryConversion)

clr.AddReference('RevitAPIUI')
from Autodesk.Revit.UI import *
from Autodesk.Revit.UI.Selection import *

clr.AddReference('RevitServices')
import RevitServices
from RevitServices.Persistence import DocumentManager

doc = DocumentManager.Instance.CurrentDBDocument
uidoc = DocumentManager.Instance.CurrentUIApplication.ActiveUIDocument

#First move
if IN[0] == True:
	TaskDialog.Show("Info", "Pick your square then hit the escape key")

outPt = []
flag = True
while flag:
	try:
		pt = uidoc.Selection.PickPoint("Pick your square then hit the escape key")
		outPt.append(pt.ToPoint())
	except:
		flag = False
		break

OUT = outPt
# ----------------------------------------

# group: Check user has played on board
containmentTest = Polygon.ContainmentTest(polygon=code_block_6, point=square_choose_1, lacing=CrossProduct)
flatten_2 = List.Flatten(list=containmentTest)
python_script = Python(IN[0]=flatten_2)
# ---------- python_script.python (4 lines) ----------
for index, value in enumerate(IN[0]):
	if value == True:
		OUT = index
	
# ----------------------------------------

# group: Filter any O or X that is not on the board
# note: location of each X or O
location = FamilyInstance.Location(familyInstance=byFamilyType)
python_script_2 = Python(IN[0]=location)
# ---------- python_script_2.python (12 lines) ----------
# Load the Python Standard and DesignScript Libraries
import sys
import clr
clr.AddReference('ProtoGeometry')
from Autodesk.DesignScript.Geometry import *

clr.AddReference ('DSCoreNodes')
import DSCore
from DSCore import *

#Zips the lists
OUT = List.Flatten (zip (IN[0][0], IN[0][1]))
# ----------------------------------------
# note: The entire board
byGeometry = BoundingBox.ByGeometry(geom=flatten)
# note: Are these X or O on the board?
contains = BoundingBox.Contains(boundingBox=byGeometry, point=python_script_2)
# note: Keep family instance and locations
# if they're on the board
filterByBoolMask = List.FilterByBoolMask(list=python_script_2, mask=contains)

# group: Current O and X locations
containmentTest_2 = Polygon.ContainmentTest(polygon=code_block_5, point=filterByBoolMask.in, lacing=CrossProduct)
# note: bool list of taken squares
transpose_2 = List.Transpose(lists=containmentTest_2)
flatten_3 = List.Flatten()  # unwired: list
# note: Create all false list if board is empty
map = List.Map(list=transpose_2, f_x=flatten_3)
python_script_3 = Python(IN[0]=map)
# ---------- python_script_3.python (4 lines) ----------
if IN[0][0] == None: 
	OUT = [[False, False, False, False, False, False, False, False, False]]
else:
	OUT = IN[0]
# ----------------------------------------

# group: CODE
# note: Main game code
python_script_4 = Python(IN[0]=python_script_3, IN[1]=python_script)
# ---------- python_script_4.python (78 lines) ----------
import random 

moose = [ ] 
wins = [ # possible win combos
	range(0, 2 + 1), # rows
	range(3, 5 + 1),
	range(6, 8 + 1),
	range(0, 6 + 1, 3), # cols
	range(1, 7 + 1, 3),
	range(2, 8 + 1, 3),
	range(0, 8 + 1, 4), # diags
	range(2, 6 + 1, 2),
]

def check_win():
	for possible_pos in range(len(wins)): # loop all possible win combos
		possible_winner = ''
		for pos in range(len(wins[possible_pos])): # loop current win positions
			current = board[wins[possible_pos][pos]] # get current board value from this possible win position
			if current == False: # ignore if not x or o
				break
			if not pos: # store x or o if this is the start of the current check and skip
				possible_winner = current
				continue
			if possible_winner != current: # if position value differs, no win given
				break
			if (pos == 2 and possible_winner == current): # if all positions in win combo match then a win is given
				return possible_winner
	return False # otherwise False is given

def get_computer_move():
	possible_moves = []
	for index, value in enumerate(board):
		if value is not False:
		    continue
		possible_moves.append(index)
	computer_move = possible_moves[random.randrange(len(possible_moves))]
	board[computer_move] = "O"
	return computer_move  		

try: 
	moves = IN[0]
	turn = len(moves)
except:
	moves = [[False*9]]
	turn = len(moves)

board = [False for pos in range(9)]

for move_index, move_location_array in enumerate(moves):
	for move_location_index, has_move in enumerate(move_location_array):
		
		if has_move == False:
			continue
		
		if move_index % 2 == 0:
			fam = "X"
		else:
			fam = "O"		
			
		board[move_location_index] = fam

board[IN[1]] = "X"

winner = check_win()
computer_move = False

if winner:
	moose.append(winner + ' is the winner!')
elif turn == 8:
	moose.append('Draw!')
else:
	computer_move = get_computer_move()
	winner = check_win()
	if winner:
		moose.append(winner + ' is the winner!')

OUT = computer_move, moose
# ----------------------------------------

# group: XO locations and families
code_block_8 = CodeBlock(FamType=code_block_2) { FamType; }
# note: Get the Human and PC's moves
code_block_9 = CodeBlock(i=code_block_6, Hu=python_script, Py=python_script_4) { [i[Hu],i[Py[0]]]; }
# note: Centre points of chosen rectangles
center = Polygon.Center(polygon=code_block_9)

# group: Output to Revit
byPoint = FamilyInstance.ByPoint(familyType=code_block_8, point=center)

# group: That fun pop up
python_script_5 = Python()  # unwired: IN[0]
# ---------- python_script_5.python (87 lines) ----------
import clr
clr.AddReference('System.Windows.Forms')
clr.AddReference('System.Drawing')

from System.Drawing import *
from System.Windows.Forms import *
from System import Array, Object

class SimpleForm(Form):
    def __init__(self):
        
        # The text to show in the top bar
        self.Text = "A Simple Form"
        # The width of the form in pixels
        self.Width = 250
        # The height of the form in pixels
        self.Height = 240
        # Make the form a fixed size
        self.FormBorderStyle = FormBorderStyle.FixedDialog		
        # Position the form in the center of the screen
        self.StartPosition = FormStartPosition.CenterScreen 
        # Bring the form to the front of all windows
        self.TopMost = True
        # Show top bar controls	
        self.ControlBox = True
        self.MaximizeBox = False
        self.MinimiseBox = True
        
        # Add a button
        self.button1 = Button()
        # Set the button text
        self.button1.Text = 'Value 1'
        # Define what happens when you click the button
        self.button1.Click += self.save
        
        # Set the button width
        self.button1.Width = 100
        # Set the button height
        self.button1.Height = 180
        # Set the button location offset from the top left form pixel
        self.button1.Location = Point(10,10)
        # Set the background color for the button
        self.button1.BackColor = Color.Green
        # Add the button the form
        self.Controls.Add(self.button1)
        
        # Add another button
        self.button2 = Button()
        # Set the button text
        self.button2.Text = 'Value 2'
        # Define what happens when you click the button
        self.button2.Click += self.save2
        
        # Set the button width
        self.button2.Width = 100
        # Set the button height
        self.button2.Height = 180
        # Set the button location offset from the top left form pixel
        self.button2.Location = Point(120,10)
        # Set the background color for the button
        self.button2.BackColor = Color.Red
        # Add the button the form
        self.Controls.Add(self.button2)

    # Define what happens when you click the button		
    def save(self, sender, event):
        self.output = "Output chosen was Value 1";
        # Close the form
        self.Close();

    # Define what happens when you click the other button		
    def save2(self, sender, event):
        self.output = "Output chosen was Value 2";
        # Close the form
        self.Close();

runMe = IN[0]

if runMe:
    # Create the form
    form = SimpleForm()
    # Run the form
    Application.Run(form)
    # Get the output of the form
    OUT = form.output
else:
    OUT = "Set RunMe to True";
# ----------------------------------------
code_block_10 = CodeBlock { true; }

# group: End of game pop up
code_block_11 = CodeBlock(i=python_script_4) { i[1][0]; }
# note: Because Dynamo is static... you have to move... wait.. move..
# So code needs to be split.
# So... first move mouse click in Revit
# IF click is invalid the go is forsaken.
# If valid the square is logged... passed to the next script - computer moves THEN pop-up showing computers move.
# Then another click of mouse by user...
# This has to be wait for and repeated nodes.
# When finished there will be pop up... then a replay in Revit.
# Maybe Data Remember node..
# Then periodic run ?
python_script_6 = Python(IN[0]=code_block_11)
# ---------- python_script_6.python (39 lines) ----------
import clr
clr.AddReference('RevitAPIUI')
from Autodesk.Revit.UI import TaskDialog, TaskDialogCommonButtons, TaskDialogResult, TaskDialogCommandLinkId, TaskDialogIcon

Message = "Thanks for playing this game"
Main = IN[0]
test = [] 

for item in Main:
	test.append(1)

if "winner!" in Main:
	header = "Winner!"
elif "Draw" in Main:
	header = "Draw"
else:
	header = "ERROR"

if Message != None:
	run_me = True

mainDialog = TaskDialog(header)
mainDialog.MainInstruction = Main
mainDialog.MainContent = Message

if run_me == True:
	type =TaskDialogIcon.TaskDialogIconInformation
	mainDialog.MainIcon = type


	mainDialog.CommonButtons = TaskDialogCommonButtons.Yes;
	mainDialog.DefaultButton = TaskDialogResult.Yes;

	mainDialog.FooterText = "<a href=\"https://github.com/lukeroot\">" +"Luke Root and MoosiestMoose hope you enjoyed our game </a>";

	tResult = mainDialog.Show()
	OUT = tResult, "Pop-up Generated", False
else:
	OUT = "","No pop-up Generated", True
# ----------------------------------------
